# Grasshopper definition GH_StartUpScript_YYMMDD_ProjectName_V.gh (Grasshopper 1.0.7)

# ---- group: INPUT
data = Data(Slider(1800, range=0..10000))

data_2 = Data(Slider(1900, range=0..10000))
data_3 = Data(Slider(1500, range=0..10000))

# ----
updates_and_changes = Panel("""1. Insert here
2. Insert here""")
# READ ME
# Note(s): 1. Make sure the Rhino project is in "mm".
package_s_needed = Panel("Insert Here")
tested_in = Panel("YYMMDD_In Rhino version_Email")

# ---- group: SET COORDINATE AS 0,0,0, XY PLANE
# USER INPUTS
# AUTOMATIC INPUTS
# 01
# BASE INPUT
panel = Panel("0")
# DESIGN LABS
# AUTOMATIC INPUTS
# Establish robot base point
pt = ConstructPoint(XCoordinate=panel, YCoordinate=panel, ZCoordinate=panel)
xy = XYPlane(Origin=pt)
# MAIN FUNCTION
# UI / OUTPUTS
# PROCESSING FUNCTIONS
# HELPERS
output_originplane = Plane(xy)
