# Grasshopper definition GH_UserInteraction_Counter.gh (Grasshopper 1.0.7)
# plug-ins: Fologram For Grasshopper Utilities, G E N E R A T I O N

# ---- group: ADD-IN (FOLOGRAM)
toggle = BooleanToggle(True)  # disabled
para_forcereset = Data(toggle)

# ----
para_forcereset_2 = Data(para_forcereset)
# USER INPUTS
# INPUTS
# 01
# READ ME
# Note(s): 1. These trigger button(s) can be easily hooked up with Fologram interface
# Tested In: 221215_In Rhino 7_weiwin.loy@hdr.qut.edu.au.
para_trigger = Button()
para_reset = Button()
para_maxnumber = Slider(30, range=0..100)
para_maxnumber_2 = Number(para_maxnumber)

# ----
# DESIGN LABS
# AUTOMATIC INPUTS
bool_trigger = Data(para_trigger)
or = GateOr(A=para_reset, B=para_forcereset_2)
bool_reset = Data(or)

# ---- group: ADD-IN (GENERATION)
# COUNTER LOGIC
bool_trigger_2 = Data(bool_trigger)
bool_reset_2 = Data(bool_reset)
count = Counter(Start=0, Step=1, Pause=bool_trigger_2, Reset=bool_reset_2)
int_result = Data(count)

# ---- group: ADD-IN (FOLOGRAM)
# HELPERS
# COUNTER LOGIC
bool_trigger_3 = Data(bool_trigger)
bool_reset_3 = Data(bool_reset)
# PROCESSING FUNCTIONS
C = Counter(Trigger=bool_trigger_3, Reset=bool_reset_3)
division = Division(A=C, B=2)
round = Round(Number=division)  # -> Nearest, Floor, Ceiling
# MAIN FUNCTION
int_result_2 = Data(round.Nearest)

para_maxnumber_3 = Number(para_maxnumber_2)
int_result_3 = Data(int_result_2)

larger = LargerThan(FirstNumber=int_result_3, SecondNumber=para_maxnumber_3)  # -> LargerThan, OrEqualTo
T = StateGate(States=larger.LargerThan, LinkTarget=toggle)

# REPORT
int_result_4 = Data(int_result_2)
# UI / OUTPUTS
panel = Panel(int_result_4)

# ---- group: ADD-IN (GENERATION)
# REPORT
int_result_5 = Data(int_result)
panel_2 = Panel(int_result_5)
